# Grasshopper definition DeBoorAlgorithmNurbs.gh (Grasshopper 1.0.7)

isperiodic = BooleanToggle(False)
pt = Point(Point(-359.1650243, 101.9842071, 0))
pt_2 = Point([Point(-364.95652, 17.7682542, 0), Point(-385.0154847, 77.43081609, 0), Point(-321.7525958, 83.08847282, 0), Point(-343.8688903, 32.16956224, 0), Point(-292.4356473, 18.79691906, 0), Point(-278.5486717, 61.48651075, 0), Point(-223.5151017, 37.82721897, 0)])
pt_3 = Point([Point(19.13106505, 37.32878588, 0), Point(10.71774169, 77.18137019, 0), Point(32.41525982, 90.24416172, 0), Point(88.43028111, 90.68696821, 0), Point(69.83240843, 41.09264107, 0), Point(109.906396, 64.11857867, 0)])
lng = ListLength(List=pt_3)
cir = Circle(Plane=PlaneXY(168.0102357, 67.28850409, 0), Radius="30")
knots = KnotVector(Count=lng, Degree="3", Periodic=isperiodic)
cp = ControlPoints(Curve=cir)  # -> Points, Weights, Knots
panel = Panel(knots)
lng_2 = ListLength(List=pt_2)
item = ListItem(List=cp.Knots, Index=-1, Wrap=True)
item_2 = ListItem(List=knots, Index=-1, Wrap=True)
remap = RemapNumbers(Value=Slider(0.384, range=0..1), Source=Domain(0, 1), Target=item)  # -> Mapped, Clipped
subtraction = Subtraction(A=lng_2, B="1")
remap_2 = RemapNumbers(Value=Slider(0.137, range=0..1), Source=Domain(0, 1), Target=item_2)  # -> Mapped, Clipped
panel_2 = Panel(remap.Mapped)
beziercurve = BezierCurve(pts=pt_2, funLength="100", funPosition=pt, textHeight="3", nums="50", u=Slider(0.769, range=0..1))  # -> out, basisFunction, legend, curvePoints, pointAtU; inputs pts: list of Point3d, funPosition: Point3d, nums: Int32
# ---------- beziercurve: Python ----------
#coding=utf-8
################################################################################
# BezierCurve.py
# Copyright (c) 2020.6 mahaidong
# Supported by ikuku.cn & caad.xyz 
# See License in the root of this repository for details.
################################################################################
import rhinoscriptsyntax as rs
import Grasshopper as gh
import Rhino
import System
from math import sqrt
import ghpythonlib.treehelpers as th

class TextGoo( gh.Kernel.Types.GH_GeometricGoo[Rhino.Display.Text3d], 
               gh.Kernel.IGH_BakeAwareData, 
               gh.Kernel.IGH_PreviewData ):

    #region construction
    def __init__(self, text):
        self.m_value = text
    
    @staticmethod
    def DuplicateText3d(original):
        if original is None: return None
        text = Rhino.Display.Text3d(original.Text, original.TextPlane, original.Height)
        text.Bold = original.Bold,
        text.Italic = original.Italic,
        text.FontFace = original.FontFace
        return text
    
    def DuplicateGeometry(self):
        return TextGoo(TextGoo.DuplicateText3d(self.m_value))
    
    #region properties
    def get_TypeName(self):
        return "3D Text"
        
    def get_TypeDescription(self):
        return "3D Text"
    
    def ToString(self):
        if self.m_value is None: return "<null>"
        return self.m_value.Text
        
    def get_Boundingbox(self):
        if self.m_value is None:
            return Rhino.Geometry.BoundingBox.Empty
        return self.m_value.BoundingBox
        
    def GetBoundingBox(self, xform):
        if self.m_value is None:
            return Rhino.Geometry.BoundingBox.Empty
        box = self.m_value.BoundingBox
        corners = xform.TransformList(box.GetCorners())
        return Rhino.Geometry.BoundingBox(corners)
    
    #region methods
    def Transform(self, xform):
        text = TextGoo.DuplicateText3d(self.m_value)
        if text is None: return TextGoo(None)
        
        plane = text.TextPlane
        point = plane.PointAt(1, 1)
        
        plane.Transform(xform)
        point.Transform(xform)
        dd = point.DistanceTo(plane.Origin)
        
        text.TextPlane = plane
        text.Height *= dd / sqrt(2)
        return TextGoo(text)
        
    def Morph(self, xmorph):
        return self.DuplicateGeometry()

    #region preview
    def get_ClippingBox(self):
        return self.get_Boundingbox()
        
    def DrawViewportWires(self, args):
        if self.m_value is None: return
        args.Pipeline.Draw3dText(self.m_value, args.Color)
      
    def DrawViewportMeshes(self, args):
        # Do not draw in meshing layer.
        pass

    #region baking
    def BakeGeometry(self, doc, att, id):
        id = System.Guid.Empty
        if self.m_value is None:
            return False, id
        if att is None:
            att = doc.CreateDefaultAttributes()
        id = doc.Objects.AddText(self.m_value, att)
        return True, id



class BezierCurve(object):

    def __init__(self, pts, textHeight):
        self.pts = pts
        self.legend = []
        self.textHeight = textHeight
        self.basisStr()
    
    def basisStr(self):
        n = len(self.pts)
        for i in range(n):
            text0 = BezierCurve.superscript("",'u',i)
            text1 = BezierCurve.superscript(text0, '(1-u)',n-1-i)
            if BezierCurve.binomial(n-1,i)==1:
                text = text0+text1+"•P"+str(i)
            else:
                text = str(BezierCurve.binomial(n-1,i))+"•"+text0+text1+"•P"+str(i)

            plane = Rhino.Geometry.Plane(self.pts[i], Rhino.Geometry.Vector3d(0,0,1))
            text3d = TextGoo(Rhino.Display.Text3d( text, plane, self.textHeight ))
            self.legend.append(text3d)
    
    def basisFunction(self,i,l, origin,nums ):
        pts = []
        n = len(self.pts)
        for j in range(nums+1):
            x = origin.X + l*j/nums
            y = origin.Y + l*BezierCurve.binomial(n-1,i)*( (j/nums)**i)*((1-j/nums)**(n-1-i))
            pts.append( Rhino.Geometry.Point3d(x,y,0) )
        return pts

    # algorithm: https://pages.mtu.edu/~shene/COURSES/cs3621/NOTES/notes.html
    def calculatePoint( self, u ): 
        p = None
        n = len(self.pts)
        for i in range(n):
            if i == 0:
                p = BezierCurve.binomial(n-1,i)*(u**i)*((1-u)**(n-1-i))*self.pts[i]
            else: 
                p += BezierCurve.binomial(n-1,i)*(u**i)*((1-u)**(n-1-i))*self.pts[i]
        return p

    def drawCurvePts(self,nums):
        pts = []
        for i in range(nums+1):
            pts.append(rs.AddPoint( self.calculatePoint( i/float(nums) ) ) )
        return pts
    

    @staticmethod
    def superscript(p,u,i):
        result =""
        if i==0:
            pass
        elif i==1:
            result +=u 
        elif i==2:
            result +=u+'\xB2'
        elif i==3:
            result +=u+'\xB3'
        else:
            result +=u+'^'+str(i)
        if p is "":
            return result
        else:
            if result is "":
                return ""
            else:
                return '•'+result

    @staticmethod
    def binomial(n, k):
        """
        A fast way to calculate binomial coefficients by Andrew Dalke.
        See http://stackoverflow.com/questions/3025162/statistics-combinations-in-python
        """
        if 0 <= k <= n:
            ntok = 1
            ktok = 1
            for t in range(1, min(k, n - k) + 1):
                ntok *= n
                ktok *= t
                n -= 1
            return ntok // ktok
        else:
            return 0

bc = BezierCurve(pts, textHeight)
legend = bc.legend
curvePoints = bc.drawCurvePts(nums)
pointAtU = []
pointAtU.append(bc.calculatePoint(u))
pointAtU.append(funPosition+Rhino.Geometry.Point3d(u*funLength,0,0))

basisFunction = []
for i in range(len(pts)):
    basisFunction.append(bc.basisFunction(i,funLength,funPosition,nums))
basisFunction = th.list_to_tree(basisFunction, source=[0,0])
# ---------- end beziercurve ----------
range = Range(Domain=Domain(0, 1), Steps=subtraction)
panel_3 = Panel(cp.Points)
panel_4 = Panel(cp.Knots)
panel_5 = Panel(cp.Weights)
panel_6 = Panel(remap_2.Mapped)
nurbs = NurbsCurve(Vertices=pt_2, Degree=subtraction, Periodic=False)  # -> Curve, Length, Domain
multiplication = Multiplication(A="100", B=0.05)
multiplication_2 = Multiplication(A=range, B=0.9)
hsl = ColourHSL(Alpha=1, Hue=multiplication_2, Saturation=1, Luminance=0.5)
flip = FlipMatrix(Data=beziercurve.legend)
cir_2 = Circle(Plane=beziercurve.pointAtU, Radius=multiplication)
col = Colour(RGB(255, 255, 255))
flip_2 = FlipMatrix(Data=hsl)
debooralgorithmnurbs = DeBoorAlgorithmNurbs(points=pt_3, knots=knots, degree="3", u=remap_2.Mapped, isPeriodic=isperiodic, isRational=Toggle(False))  # -> curvePoints, deBoorlines, pointAtU; inputs points: list of Point3d, weights: list, knots: list, degree: Int32, isPeriodic: Boolean, isRational: Boolean
# ---------- debooralgorithmnurbs: Python ----------
#coding=utf-8
################################################################################
# DeBoorAlgorithmNurbs.py
# Copyright (c) 2020.4 mahaidong
# Supported by ikuku.cn & caad.xyz 
# See License in the root of this repository for details.
################################################################################
import rhinoscriptsyntax as rs
import Rhino

class DeBoorAlgorithmNurbs(object):
    def __init__( self,degree, pts,weights,knots,isPeriodic, isRational):
        self.degree = degree
        self.pts = pts
        self.weights = weights
        self.knots = knots
        self.isPeriodic = isPeriodic
        self.isRational = isRational

    def findKnotIndexByU(self, u):
        s = 0
        index = 0 
        if u<self.knots[0] or u>self.knots[-1]:
            return
        for i in range(len(self.knots)):
            if self.knots[i]>u:
                if s==0 :
                    return s,i-1
            elif self.knots[i] == u:
                index = i
                s += 1
        if s>0:
            return s,index

    def getKnotValue(self,i):
        if self.isPeriodic == True:
            if i>=len(self.knots):
                return self.knots[-1]+( self.knots[i+1-len(self.knots)]-self.knots[0] )
            elif i<0:
                return self.knots[0]-( self.knots[-1]-self.knots[len(self.knots)+i-1] )
        return self.knots[i]

    def calculateNurbsPoint(self,u):
        lines = []
        p = self.degree
        s,k = self.findKnotIndexByU(u)
        h = p-s
        pt = {}

        # initialize pt[i][0] for starting calculation
        for i in range(k-p+1,k-s+2):
            pt[i]={}
            if i < len(self.pts):
                j = i
            else:
                j = i-len(self.pts)

            if self.isRational:
                x = self.pts[j].X*self.weights[j]
                y = self.pts[j].Y*self.weights[j]
                z = self.pts[j].Z*self.weights[j]
                w = weights[j]
            else:
                x = self.pts[j].X
                y = self.pts[j].Y
                z = self.pts[j].Z
                w = 1
            pt[i][0] = Rhino.Geometry.Point4d(x,y,z,w)

        def calculatePoint4d( p0, factor0,p1,factor1 ):
            return Rhino.Geometry.Point4d(
                p0.X*factor0+p1.X*factor1,
                p0.Y*factor0+p1.Y*factor1,
                p0.Z*factor0+p1.Z*factor1,
                p0.W*factor0+p1.W*factor1)

        # starting calculation
        a = {}
        for r in range (1,h+1):
            for i in range(k-p+r+1,k-s+2) :
                a[i]={}
                Vai_1  = self.getKnotValue( i-1 )
                Vaip_r = self.getKnotValue( i+p-r )
                a[i][r] = (u-Vai_1)/( Vaip_r-Vai_1)
                pt[i][r] = calculatePoint4d( pt[i-1][r-1],(1-a[i][r]),pt[i][r-1],a[i][r] )
                lines.append(rs.AddLine( 
                    Rhino.Geometry.Point3d(pt[i-1][r-1]),
                    Rhino.Geometry.Point3d(pt[i][r-1]) ))
        return Rhino.Geometry.Point3d(pt[k-s+1][p-s]), lines

### main ###
curvePoints = []
nurbs = DeBoorAlgorithmNurbs(degree, points, weights, knots, isPeriodic, isRational)
for f in rs.frange( nurbs.knots[0],nurbs.knots[-1],1/20.0 ):
    pt,_ = nurbs.calculateNurbsPoint(f)
    curvePoints.append(pt)
pointAtU, deBoorlines = nurbs.calculateNurbsPoint(u)
# ---------- end debooralgorithmnurbs ----------
debooralgorithmnurbs_2 = DeBoorAlgorithmNurbs(
    points=panel_3,
    weights=panel_5,
    knots=panel_4,
    degree="2",
    u=remap.Mapped,
    isPeriodic=Toggle(True),
    isRational=Toggle(True))  # -> curvePoints, deBoorlines, pointAtU; inputs points: list of Point3d, weights: list, knots: list, degree: Int32, isPeriodic: Boolean, isRational: Boolean; same code as debooralgorithmnurbs
col_2 = Colour(RGB(255, 255, 255))
preview = CustomPreview(Geometry=[beziercurve.pointAtU, cir_2, pt_2], Material=col)
custom_preview = CustomPreview(Geometry=flip, Material=flip_2)
custom_preview_2 = CustomPreview(Geometry=beziercurve.basisFunction, Material=flip_2)
custom_preview_3 = CustomPreview(Geometry=[debooralgorithmnurbs.deBoorlines, debooralgorithmnurbs.pointAtU], Material=col_2)
col_3 = Colour(RGB(255, 255, 255))
custom_preview_4 = CustomPreview(Geometry=[debooralgorithmnurbs_2.deBoorlines, debooralgorithmnurbs_2.pointAtU], Material=col_3)
