# Grasshopper definition DeBoorAlgorithmNurbs_Mac.gh (Grasshopper 1.0.7)

crv = Curve(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)
panel = Panel("""0
0
0
0
0
1
1
1
1
1""")
cp = ControlPoints(Curve=crv)  # -> Points, Weights, Knots
panel_2 = Panel("""{-44.603793, -57.325494, 0}
{-78.772834, -19.162668, 0}
{-75.666558, 56.275475, 0}
{1.102846, 84.675717, 0}
{73.434713, 18.112649, 0}
{44.146963, -55.994232, 0}""")
panel_3 = Panel("""1
0.707107
1
0.707107
1
0.707107
1
0.707107
1""")
pt = Point(cp.Points)
panel_4 = Panel("""0
0
2
2
4
4
6
6
8
8""")
debooralgorithmnurbs = DeBoorAlgorithmNurbs(points=panel_2, knots=panel, degree="5", u="0.12", isPeriodic=Toggle(False), isRational=Toggle(False))  # -> curvePoints, deBoorlines, pointAtU; inputs points: list of Point3d, weights: list, knots: list, degree: Int32, isPeriodic: Boolean, isRational: Boolean
# ---------- debooralgorithmnurbs: Python ----------
#coding=utf-8
################################################################################
# DeBoorAlgorithmNurbs.py
# Copyright (c) 2020.4 mahaidong
# Supported by ikuku.cn & caad.xyz 
# See License in the root of this repository for details.
################################################################################
import rhinoscriptsyntax as rs
import Rhino

def calculatePoint4d(p0, factor0,p1,factor1):
    return Rhino.Geometry.Point4d(
        p0.X*factor0+p1.X*factor1,
        p0.Y*factor0+p1.Y*factor1,
        p0.Z*factor0+p1.Z*factor1,
        p0.W*factor0+p1.W*factor1)
def findKnotIndexByU(u,knots):
    s = 0
    index = 0 
    if u<knots[0] or u>knots[-1]:
        return
    for i in range(len(knots)):
        if knots[i]>u:
            if s==0 :
                return s,i-1
        elif knots[i] == u:
            index = i
            s += 1
    if s>0:
        return s,index
def getKnotValue(isPeriodic,knots,i):
    if isPeriodic == True:
        if i>=len(knots):
            return knots[-1]+knots[i+1-len(knots)]
        elif i<0:
            return -knots[-1]+knots[i-1]
    return knots[i]


def calculateNurbsPoint(u):
    lines = []
    p = degree
    s,k = findKnotIndexByU(u,knots)
    h = p-s
    pt = {}

    # initialize pt[i][0] for starting calculation
    for i in range(k-p+1,k-s+2):
        pt[i]={}
        if i < len(points):
            j = i
        else:
            j = i-len(points)
        if isRational:
            x = points[j].X*weights[j]
            y = points[j].Y*weights[j]
            z = points[j].Z*weights[j]
            w = weights[j]
        else:
            x = points[j].X
            y = points[j].Y
            z = points[j].Z
            w = 1
        pt[i][0] = Rhino.Geometry.Point4d(x,y,z,w)

    # starting calculation
    a = {}
    for r in range (1,h+1):
        for i in range(k-p+r+1,k-s+2) :
            a[i]={}
            Vai_1  = getKnotValue( isPeriodic,knots,i-1)
            Vaip_r = getKnotValue( isPeriodic,knots,i+p-r)
            a[i][r] = (u-Vai_1)/( Vaip_r-Vai_1)
            pt[i][r] = calculatePoint4d(pt[i-1][r-1],(1-a[i][r]),pt[i][r-1],a[i][r])
            lines.append(rs.AddLine( 
                Rhino.Geometry.Point3d(pt[i-1][r-1]),
                Rhino.Geometry.Point3d(pt[i][r-1]) ))
    return Rhino.Geometry.Point3d(pt[k-s+1][p-s]), lines

curvePoints = []
for f in rs.frange(knots[0],knots[-1],1/20.0):
    pt,_ = calculateNurbsPoint(f)
    curvePoints.append(pt)
pointAtU, deBoorlines = calculateNurbsPoint(u)
# ---------- end debooralgorithmnurbs ----------
remap = RemapNumbers(Value=Slider(0.362, range=0..1), Source=Domain(0, 1), Target="8")  # -> Mapped, Clipped
debooralgorithmnurbs_2 = DeBoorAlgorithmNurbs(points=pt, weights=panel_3, knots=panel_4, degree="2", u=remap.Mapped, isPeriodic=Toggle(False), isRational=Toggle(True))  # -> curvePoints, deBoorlines, pointAtU; inputs points: list of Point3d, weights: list, knots: list, degree: Int32, isPeriodic: Boolean, isRational: Boolean; same code as debooralgorithmnurbs
