# Grasshopper definition DeBoorAlgorithmNurbs_Win.gh (Grasshopper 1.0.7)
# plug-ins: DeBoorAlgorithmNurbs

crv = Curve(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)
panel = Panel("""0
0
0
0
0
1
1
1
1
1""")
cp = ControlPoints(Curve=crv)  # -> Points, Weights, Knots
panel_2 = Panel("""{-44.603793, -57.325494, 0}
{-78.772834, -19.162668, 0}
{-75.666558, 56.275475, 0}
{1.102846, 84.675717, 0}
{73.434713, 18.112649, 0}
{44.146963, -55.994232, 0}""")
panel_3 = Panel("""1
0.707107
1
0.707107
1
0.707107
1
0.707107
1""")
pt = Point(cp.Points)
panel_4 = Panel("""0
0
2
2
4
4
6
6
8
8""")
deboor = DeBoorAlgorithmNurbs(Points=panel_2, Knots=panel, Degree="5", U="0.12", IsPeriodic=Toggle(False), IsRational=Toggle(False))  # -> CurvePoints, DeBoorlines, PointAtU
remap = RemapNumbers(Value=Slider(0.379, range=0..1), Source=Domain(0, 1), Target="8")  # -> Mapped, Clipped
col = Colour(RGB(255, 255, 255))
deboor_2 = DeBoorAlgorithmNurbs(Points=pt, Weights=panel_3, Knots=panel_4, Degree="2", U=remap.Mapped, IsPeriodic=Toggle(False), IsRational=Toggle(True))  # -> CurvePoints, DeBoorlines, PointAtU
pt_2 = Point(deboor.CurvePoints)
preview = CustomPreview(Geometry=[deboor.DeBoorlines, deboor.PointAtU], Material=col)
col_2 = Colour(RGB(255, 255, 255))
preview_2 = CustomPreview(Geometry=[deboor_2.DeBoorlines, deboor_2.PointAtU], Material=col_2)
