# Grasshopper definition DeBoorAlgorithmNurbs.gh (Grasshopper 1.0.7)

isperiodic = BooleanToggle(False)
pt = Point([Point(19.13106505, 37.32878588, 0), Point(10.71774169, 77.18137019, 0), Point(32.41525982, 90.24416172, 0), Point(88.43028111, 90.68696821, 0), Point(69.83240843, 41.09264107, 0), Point(109.906396, 64.11857867, 0)])
path = FilePath("/Users/apple/Documents/caad/repos/DeBoorAlgorithmNurbs/src/BezierCurve.py")
pt_2 = Point([Point(-364.95652, 17.7682542, 0), Point(-385.0154847, 77.43081609, 0), Point(-321.7525958, 83.08847282, 0), Point(-343.8688903, 32.16956224, 0), Point(-292.4356473, 18.79691906, 0), Point(-278.5486717, 61.48651075, 0), Point(-223.5151017, 37.82721897, 0)])
file = ReadFile(File=path, PerLineParse=False)
lng = ListLength(List=pt)
cir = Circle(Plane=PlaneXY(168.0102357, 67.28850409, 0), Radius="30")
knots = KnotVector(Count=lng, Degree="3", Periodic=isperiodic)
cp = ControlPoints(Curve=cir)  # -> Points, Weights, Knots
pt_3 = Point(Point(-359.1650243, 101.9842071, 0))
panel = Panel(knots)
lng_2 = ListLength(List=pt_2)
item = ListItem(List=cp.Knots, Index=-1, Wrap=True)
item_2 = ListItem(List=knots, Index=-1, Wrap=True)
remap = RemapNumbers(Value=Slider(0.384, range=0..1), Source=Domain(0, 1), Target=item)  # -> Mapped, Clipped
subtraction = Subtraction(A=lng_2, B="1")
remap_2 = RemapNumbers(Value=Slider(0.137, range=0..1), Source=Domain(0, 1), Target=item_2)  # -> Mapped, Clipped
panel_2 = Panel(remap.Mapped)
beziercurve = GhPythonScript(Code=file, Pts=pt_2, FunLength="100", FunPosition=pt_3, TextHeight="3", Nums="50", U=Slider(0.769, range=0..1))  # -> Out, BasisFunction, Legend, CurvePoints, PointAtU
range = Range(Domain=Domain(0, 1), Steps=subtraction)
panel_3 = Panel(cp.Points)
panel_4 = Panel(cp.Knots)
panel_5 = Panel(cp.Weights)
multiplication = Multiplication(A="100", B=0.05)
multiplication_2 = Multiplication(A=range, B=0.9)
nurbs = NurbsCurve(Vertices=pt_2, Degree=subtraction, Periodic=False)  # -> Curve, Length, Domain
panel_6 = Panel(remap_2.Mapped)
cir_2 = Circle(Plane=beziercurve.PointAtU, Radius=multiplication)
hsl = ColourHSL(Alpha=1, Hue=multiplication_2, Saturation=1, Luminance=0.5)
flip = FlipMatrix(Data=beziercurve.Legend)
path_2 = FilePath("/Users/apple/Documents/caad/repos/DeBoorAlgorithmNurbs/src/DeBoorAlgorithmNurbs.py")
flip_2 = FlipMatrix(Data=hsl)
file_2 = ReadFile(File=path_2, PerLineParse=False)
col = Colour(RGB(255, 255, 255))
preview = CustomPreview(Geometry=[beziercurve.PointAtU, pt_2, cir_2], Material=col)
preview_2 = CustomPreview(Geometry=[beziercurve.BasisFunction, flip], Material=flip_2)
debooralgorithmnurbs = GhPythonScript(Code=file_2, Points=pt, Knots=knots, Degree="3", U=remap_2.Mapped, IsPeriodic=isperiodic, IsRational=Toggle(False))  # -> Out, CurvePoints, DeBoorlines, PointAtU
path_3 = FilePath("/Users/apple/Documents/caad/repos/DeBoorAlgorithmNurbs/src/DeBoorAlgorithmNurbs.py")
file_3 = ReadFile(File=path_3, PerLineParse=False)
debooralgorithmnurbs_2 = GhPythonScript(
    Code=file_3,
    Points=panel_3,
    Weights=panel_5,
    Knots=panel_4,
    Degree="2",
    U=remap.Mapped,
    IsPeriodic=Toggle(True),
    IsRational=Toggle(True))  # -> CurvePoints, DeBoorlines, PointAtU
col_2 = Colour(RGB(255, 255, 255))
preview_3 = CustomPreview(Geometry=[debooralgorithmnurbs.DeBoorlines, debooralgorithmnurbs.PointAtU], Material=col_2)
col_3 = Colour(RGB(255, 255, 255))
preview_4 = CustomPreview(Geometry=[debooralgorithmnurbs_2.PointAtU, debooralgorithmnurbs_2.DeBoorlines], Material=col_3)
