# Grasshopper definition DeBoorAlgorithmNurbsPy.gh (Grasshopper 1.0.7)

isperiodic = BooleanToggle(False)
path = FilePath("C:\msys64\home\mahai\repos\python-sample\python4rhino\05-curve\DeBoorAlgorithmNurbs.py")
pt = Point([Point(-37.56954049, -10.93893819, 0), Point(0.1963165841, 19.96039942, 0), Point(12.05666839, -15.30854149, 0), Point(36.2455438, 7.007646784, 0), Point(49.97858273, -8.442022021, 0), Point(58.71778933, 13.40599447, 0)])
crv = Curve(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)
cp = ControlPoints(Curve=crv)  # -> Points, Weights, Knots
pt_2 = Point(cp.Points)
python = GhPythonScript(pt=pt, degree="3", periodic=isperiodic)  # -> out, lenPoints, rangeKnot; inputs pt: list of Point3d, degree: Int32, periodic: Boolean
# ---------- python: Python ----------
__author__ = "mahai"
__version__ = "2020.04.20"

import rhinoscriptsyntax as rs

if periodic:
   rangeKnot = len(pt)+1
else:
    rangeKnot = len(pt)-degree

lenPoints = len(pt)
# ---------- end python ----------
panel = Panel(cp.Knots)
file = ReadFile(File=path, PerLineParse=False)
panel_2 = Panel("""0
0
2
2
4
4
6
6
8
8""")
knots = KnotVector(Count=python.lenPoints, Degree="3", Periodic=isperiodic)
remap = RemapNumbers(Value=Slider(0.299, range=0..1), Source=Domain(0, 1), Target=python.rangeKnot)  # -> Mapped, Clipped
remap_2 = RemapNumbers(Value=Slider(0.426, range=0..1), Source=Domain(0, 1), Target="8")  # -> Mapped, Clipped
panel_3 = Panel(remap.Mapped)
python_2 = GhPythonScript(Code=file, Points=pt, Knots=knots, Degree="3", U=remap.Mapped, IsPeriodic=isperiodic, IsRational=Toggle(False))  # -> Out, CurvePoints, DeBoorlines, PointAtU
debooralgorithmnurbs = GhPythonScript(
    Code=file,
    Points=pt_2,
    Weights=cp.Weights,
    Knots=panel_2,
    Degree="2",
    U=remap_2.Mapped,
    IsPeriodic=Toggle(False),
    IsRational=Toggle(True))  # -> CurvePoints, DeBoorlines, PointAtU
col = Colour(RGB(255, 255, 255))
col_2 = Colour(RGB(255, 255, 255))
preview = CustomPreview(Geometry=[python_2.DeBoorlines, python_2.PointAtU], Material=col_2)
preview_2 = CustomPreview(Geometry=[debooralgorithmnurbs.PointAtU, debooralgorithmnurbs.DeBoorlines], Material=col)
